# Grasshopper definition gh-ground-truth.ghx (Grasshopper 1.0.7)
# plug-ins: Docofossor

sandbox = Brep(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)
scan = GhPythonScript(activate=Toggle(False), start_proxy=Toggle(False), initialise_proxy=Button())  # -> out, f; inputs activate: Boolean, start_proxy: Boolean, initialise_proxy: Boolean
# ---------- scan: Python ----------
from compas_ghpython import unload_modules
from compas_ghpython import artists
unload_modules('groundtruth')
from compas.rpc import Proxy

#proxy=Proxy()
#proxy.stop_server()

interface = None

if activate:
    interface = Proxy('groundtruth.interactive.interface')
    if initialise_proxy:
        interface.restart_server()
    if start_proxy:
        interface.start_server()
    else:
        interface.stop_server()
        
        
if interface and start_proxy:
    f = interface.get_height_grid()
# ---------- end scan ----------
messages = Panel(scan.out)

# ---- group: height map visualization
dam = DataDam(DataA=scan.f, BufferDelay=10000000, BufferMode=0)
dfimportasc = ImportASC(F=dam)
dfgridmesh = GridMesh(Df=dfimportasc)
coloring_mesh = ColoringMesh(mesh=dfgridmesh)
mesh = Mesh(coloring_mesh)

# ==== cluster ColoringMesh
mesh = ClusterInput()
mesh_2 = Mesh(mesh)
demesh = DeconstructMesh(Mesh=mesh_2)  # -> Vertices, Faces, Colours, Normals
pdecon = Deconstruct(Point=demesh.Vertices)  # -> XComponent, YComponent, ZComponent
bnd = Bounds(Numbers=pdecon.ZComponent)
remap = RemapNumbers(Value=pdecon.ZComponent, Source=bnd, Target=Domain(0, 1))  # -> Mapped, Clipped
frgb = ColourRGBF(Alpha=1, Red=remap.Mapped, Green=remap.Mapped, Blue=remap.Mapped)
mcol = MeshColours(Mesh=mesh_2, Colours=frgb)
M = ClusterOutput(mcol)
